# Grasshopper definition beam.ghx (Grasshopper 1.0.7)

rh_in_length = Slider(4, range=0.3..7)

# ---- group: RH_IN:Height
number_slider = Slider(0.4, range=0.2..0.4)

# ----
rh_in_width = Slider(0.3, range=0.2..0.4)
Y = UnitY(Factor=rh_in_length)
division = Division(A=rh_in_width, B=2)
division_2 = Division(A=number_slider, B=2)
multiplication = Multiplication(A=division_2, B=-1)
pt = Point(Point(0, 0, 0))
multiplication_2 = Multiplication(A=division, B=-1)
dom = ConstructDomain(DomainStart=multiplication, DomainEnd=division_2)
dom_2 = ConstructDomain(DomainStart=multiplication_2, DomainEnd=division)
pl = ConstructPlane(Origin=pt, XAxis="{1, 0, 0}", YAxis="{0, 0, -1}")
rectangle = Rectangle(Plane=pl, XSize=dom_2, YSize=dom, Radius=0)  # -> Rectangle, Length
pflip = FlipPlane(Plane=pl, ReverseX=False, ReverseY=False, SwapAxes=True)
move = Move(Geometry=pl, Motion=Y)  # -> Geometry, Transform
boxrec = BoxRectangle(Rectangle=rectangle.Rectangle, Height=rh_in_length)
mesh = MeshBrep(
    Brep=boxrec,
    Settings={GridMaxCount=0, GridMinCount=16, JaggedSeams=False, MaxEdgeLength=0, MinEdgeLength=0.0001, MinTolerance=0, Refine=True, RefineAngle=0, RelativeTolerance=0.65, SimplePlanes=True, Tolerance=0})
pi = Pi(Factor="1/2")
prot = RotatePlane(Plane=pflip, Angle=pi)

# ---- group: RH_OUT:ComponentInterface_Column_2
pln = Plane(prot)

# ---- group: RH_OUT:ComponentInterface_Column_1
pln_2 = Plane(move.Geometry)

# ---- group: RH_OUT:ComponentGeo
cylinder = Geometry(mesh)
