# Grasshopper definition column.ghx (Grasshopper 1.0.7)

rh_in_sidelength = Slider(0.3, range=0.2..0.4)
rh_in_consoleoffset = Slider(0.4, range=0.2..0.4)
rh_in_height = Slider(3.2, range=0.5..4)
panel = Panel("Height")
panel_2 = Panel("SideLength")
panel_3 = Panel("ConsoleOffset")
division = Division(A=rh_in_sidelength, B="2")
multiplication = Multiplication(A=division, B="-1")
dom = ConstructDomain(DomainStart=multiplication, DomainEnd=division)
rectangle = Rectangle(Plane=PlaneXY(0, 0, 0), XSize=dom, YSize=dom, Radius=0)  # -> Rectangle, Length
boxrec = BoxRectangle(Rectangle=rectangle.Rectangle, Height=rh_in_height)
debrep = DeconstructBrep(Brep=boxrec)  # -> Faces, Edges, Vertices
num = Number(0.3)
python = GhPythonScript(brep_edges=debrep.Edges, console_offset=rh_in_consoleoffset)  # -> highest_edge_xz, interface_center_xz, highest_edge_yz, interface_center_yz; inputs brep_edges: list of Curve
# ---------- python: Python ----------
__author__ = "ga24nix"
__version__ = "2023.08.17"

import rhinoscriptsyntax as rs
import Rhino.Geometry as rg

idx_highest_xz_point = 0
highest_point_xz = brep_edges[0].PointAtNormalizedLength(0.5)
idx_highest_yz_point = 0
highest_point_yz = brep_edges[0].PointAtNormalizedLength(0.5)

#find edge that is farest from the origin in xz-extension
idx = 0
for edge in brep_edges:
    point_to_compare = edge.PointAtNormalizedLength(0.5)
    if point_to_compare.Z >= highest_point_xz.Z and point_to_compare.X >= highest_point_xz.X:
        highest_point_xz = point_to_compare
        idx_highest_point_xz = idx
    idx=idx+1

highest_edge_xz = brep_edges[idx_highest_point_xz]
interface_center_xz = highest_point_xz
interface_center_xz.Z = interface_center_xz.Z -console_offset/2


idx=0
#find edge that is farest from the origin in yz-extension
for edge in brep_edges:
    point_to_compare = edge.PointAtNormalizedLength(0.5)
    if point_to_compare.Z >= highest_point_yz.Z and point_to_compare.Y >= highest_point_yz.Y:
        highest_point_yz = point_to_compare
        idx_highest_point_yz = idx
    idx=idx+1

highest_edge_yz = brep_edges[idx_highest_point_yz]
interface_center_yz = highest_point_yz
interface_center_yz.Z = interface_center_yz.Z -console_offset/2
# ---------- end python ----------
python_2 = GhPythonScript(
    highest_edge_xz=python.highest_edge_xz,
    highest_edge_yz=python.highest_edge_yz,
    console_offset=rh_in_consoleoffset,
    console_height=num)  # -> console_xz, console_yz; inputs highest_edge_xz: Curve, highest_edge_yz: Curve
# ---------- python_2: Python ----------
__author__ = "ga24nix"
__version__ = "2023.08.17"

import rhinoscriptsyntax as rs
import Rhino.Geometry as rg

# xz part
edge_point_lower_y_xz = highest_edge_xz.PointAtStart
edge_point_higher_y_xz = highest_edge_xz.PointAtEnd

console_xz_lower_point = edge_point_lower_y_xz
console_xz_lower_point.Z = console_xz_lower_point.Z - console_offset - console_height

console_xz_higher_point = edge_point_higher_y_xz 
console_xz_higher_point.Z = console_xz_higher_point.Z - console_offset

vector = rg.Vector3d(edge_point_lower_y_xz.X, 0.0, 0.0)
plane = rg.Plane.WorldYZ
plane.Translate(vector)
console_xz = rg.Rectangle3d(plane, console_xz_lower_point, console_xz_higher_point)


# yz part
edge_point_lower_y_yz = highest_edge_yz.PointAtStart
edge_point_higher_y_yz = highest_edge_yz.PointAtEnd

console_yz_lower_point = edge_point_lower_y_yz
console_yz_lower_point.Z = console_yz_lower_point.Z - console_offset - console_height

console_yz_higher_point = edge_point_higher_y_yz 
console_yz_higher_point.Z = console_yz_higher_point.Z - console_offset

vector = rg.Vector3d(0.0, edge_point_lower_y_yz.Y, 0.0)
plane = rg.Plane.WorldZX
plane.Translate(vector)
console_yz = rg.Rectangle3d(plane, console_yz_lower_point, console_yz_higher_point)
# ---------- end python_2 ----------
boxrec_2 = BoxRectangle(Rectangle=python_2.console_xz, Height=rh_in_sidelength)
boxrec_3 = BoxRectangle(Rectangle=python_2.console_yz, Height=rh_in_sidelength)
sunion = SolidUnion(Breps=flatten([boxrec, boxrec_2, boxrec_3]))
pt = ConstructPoint(XCoordinate=0, YCoordinate=0, ZCoordinate=rh_in_height)
pl = ConstructPlane(Origin=pt, XAxis="{1, 0, 0}", YAxis="{0, 1, 0}")
mesh = MeshBrep(
    Brep=sunion,
    Settings={GridMaxCount=0, GridMinCount=16, JaggedSeams=False, MaxEdgeLength=0, MinEdgeLength=0.0001, MinTolerance=0, Refine=True, RefineAngle=0, RelativeTolerance=0.65, SimplePlanes=True, Tolerance=0})
pl_2 = ConstructPlane(Origin=python.interface_center_xz, XAxis="{0, 1, 0}", YAxis="{0, 0, 1}")
pl_3 = ConstructPlane(Origin=python.interface_center_yz, XAxis=Vector(1, 0, 0), YAxis="{0, 0, -1}")
pl_4 = ConstructPlane(Origin=Point(0, 0, 0), XAxis="{1, 0, 0}", YAxis="{0, -1, 0}")

# ---- group: RH_OUT:ComponentInterface_Deck
pln = Plane(pl)

# ---- group: RH_OUT:ComponentInterface_Beam_2
pln_2 = Plane(pl_3)

# ---- group: RH_OUT:ComponentInterface_Beam_1
pln_3 = Plane(pl_2)

# ---- group: RH_OUT:ComponentGeo
cylinder = Geometry(mesh)

# ---- group: RH_OUT:ComponentInterface_Foundation
pln_4 = Plane(pl_4)
