# Grasshopper definition foundation.ghx (Grasshopper 1.0.7)

rh_in_sidelength = Slider(1.5, range=0.5..1.5)
division = Division(A=rh_in_sidelength, B="2")
multiplication = Multiplication(A=division, B="-1")
pl = ConstructPlane(Origin=Point(0, 0, 0), XAxis="{1, 0, 0}", YAxis="{0, 1, 0}")
dom = ConstructDomain(DomainStart=multiplication, DomainEnd=division)
rectangle = Rectangle(Plane=pl, XSize=dom, YSize=dom, Radius=0)  # -> Rectangle, Length
boxrec = BoxRectangle(Rectangle=rectangle.Rectangle, Height=Slider(-0.6, range=-1..-0.5))
mesh = MeshBrep(
    Brep=boxrec,
    Settings={GridMaxCount=0, GridMinCount=16, JaggedSeams=False, MaxEdgeLength=0, MinEdgeLength=0.0001, MinTolerance=0, Refine=True, RefineAngle=0, RelativeTolerance=0.65, SimplePlanes=True, Tolerance=0})

# ---- group: RH_OUT:ComponentGeo
cylinder = Geometry(mesh)

# ---- group: RH_OUT:ComponentInterface_Column
pln = Plane(pl)
