# Grasshopper definition wasp column beam sample assembly.gh (Grasshopper 1.0.7)

pt = Point(Point(1, 0.5, 4))
pt_2 = Point(Point(0.4703510164, 1, 4))
pl = ConstructPlane(Origin=pt, XAxis="{0, 1, 0}", YAxis="{0, 0, 1}")
pl_2 = ConstructPlane(Origin=pt_2, XAxis="{1, 0, 0}", YAxis="{0, 0, 1}")
connpln = Wasp_ConnectionFromPlane(PLN=pl)  # -> CONN, PLN_OUT; inputs PLN: list of Plane, T: list; plug-in component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
pt_3 = Point(Point(0.5, 18, 1))
pt_4 = Point(Point(0.5, 1, 1))
connpln_2 = Wasp_ConnectionFromPlane(PLN=pl_2)  # -> CONN, PLN_OUT; inputs PLN: list of Plane, T: list; plug-in component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
brep = Brep(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)
brep_2 = Brep(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)
pl_3 = ConstructPlane(Origin=pt_4, XAxis="{1, 0, 0}", YAxis="{0, 0, -1}")
pl_4 = ConstructPlane(Origin=pt_3, XAxis="{1, 0, 0}", YAxis="{0, 0, -1}")
brep_3 = Brep(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)
mesh = MeshBrep(
    Brep=brep,
    Settings={GridMaxCount=0, GridMinCount=16, JaggedSeams=False, MaxEdgeLength=0, MinEdgeLength=0.0001, MinTolerance=0, Refine=True, RefineAngle=0, RelativeTolerance=0.65, SimplePlanes=True, Tolerance=0})
connpln_3 = Wasp_ConnectionFromPlane(PLN=pl_4)  # -> CONN, PLN_OUT; inputs PLN: list of Plane, T: list; plug-in component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
connpln_4 = Wasp_ConnectionFromPlane(PLN=pl_3)  # -> CONN, PLN_OUT; inputs PLN: list of Plane, T: list; plug-in component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
Y = UnitY(Factor=Slider(18, range=0..100))
part = Wasp_BasicPart(NAME="column", GEO=brep_2, CONN=flatten([connpln.CONN, connpln_2.CONN]), COLL=mesh)  # -> PART; inputs GEO: Mesh, CONN: list, ATTR: list; plug-in component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
line = Line(Line((0.5, 0.5, 0), (0.489390437, 0.5, 4)))
part_2 = Wasp_BasicPart(NAME="beam", GEO=brep_3, CONN=flatten([connpln_4.CONN, connpln_3.CONN]))  # -> PART; inputs GEO: Mesh, CONN: list, ATTR: list; plug-in component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
move = Move(Motion=Y)  # -> Geometry, Transform
rotax = RotateAxis(Angle="-0.5*Pi", Axis=line)  # -> Geometry, Transform
comp = Compound(Transforms=[rotax.Transform, move.Transform])
parttr = Wasp_TransformPart(PART=part, TR=comp)  # -> PART_OUT; inputs TR: Transform; plug-in component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
rule = Wasp_Rule(P1="column", C1="1", P2="beam", C2="0")  # -> R; inputs C1: Int32, C2: Int32; plug-in component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
rule_2 = Wasp_Rule(P1="column", C1="0", P2="beam", C2="1")  # -> R; inputs C1: Int32, C2: Int32; plug-in component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
stochasticaggregation = Wasp_StochasticAggregation(PART=flatten([part, part_2]), PREV=[part, parttr], N=Slider(3, range=0..4), RULES=[rule_2, rule], RESET=Toggle(True))  # -> AGGR, PART_OUT; inputs PART: list, PREV: list, N: Int32, RULES: list, SEED: Int32, MODE: Int32, GC: list, RESET: Boolean; plug-in component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
partgeo = Wasp_GetPartGeometry(PART=stochasticaggregation.PART_OUT)  # -> GEO; plug-in component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
