# Grasshopper definition deck.ghx (Grasshopper 1.0.7)

rh_in_yextension = Slider(20, range=1..20)
rh_in_xextension = Slider(12.3, range=1..20)
rh_in_zextension = Slider(0.4, range=-0.6..0.4)
rh_in_columnthickness = Slider(0.3, range=-0.6..0.4)
pt = ConstructPoint(XCoordinate=rh_in_xextension, YCoordinate=rh_in_yextension, ZCoordinate=0)
rec_2pt = Rectangle2Pt(Plane=PlaneXY(0, 0, 0), PointA=Point(0, 0, 0), PointB=pt, Radius=0)  # -> Rectangle, Length
multiplication = Multiplication(A=rh_in_zextension, B=-1)
python = GhPythonScript(
    x_extension=rh_in_xextension,
    y_extension=rh_in_yextension,
    z_extension=rh_in_zextension,
    column_thickness=rh_in_columnthickness)  # -> a, b, c, d
# ---------- python: Python ----------
__author__ = "ga24nix"
__version__ = "2023.08.18"

import rhinoscriptsyntax as rs
import Rhino.Geometry as rg
import math

# reference points
x1 = column_thickness/2
y1 = x1

x2 = x1
y2 = y_extension - column_thickness/2

x3 = x_extension - column_thickness/2
y3 = y2

x4 = x_extension - column_thickness/2
y4 = y1

z1_to_4 = z_extension

points  = [
[x1, y1, z1_to_4],
[x2, y2, z1_to_4], 
[x3, y3, z1_to_4],
[x4, y4, z1_to_4],
]


#computation, rotated 90 degrees at the corners
interface_planes_to_top_clockwise_ordered = []
for i in range(0,4):
    plane = rg.Plane.WorldXY
    axis = rg.Vector3d.ZAxis
    center_of_rotation = rg.Point3d(0.0, 0.0, 0.0)
    plane.Rotate(i*0.5*math.pi*(-1), axis, center_of_rotation)
    reference_point = rg.Vector3d(points[i][0], points[i][1], points[i][2])
    plane.Translate(reference_point)
    interface_planes_to_top_clockwise_ordered.append(plane)
    
a = interface_planes_to_top_clockwise_ordered[0]
b = interface_planes_to_top_clockwise_ordered[1]
c = interface_planes_to_top_clockwise_ordered[2]
d = interface_planes_to_top_clockwise_ordered[3]
# ---------- end python ----------
Z = UnitZ(Factor=multiplication)
boxrec = BoxRectangle(Rectangle=rec_2pt.Rectangle, Height=rh_in_zextension)
mesh = MeshBrep(
    Brep=boxrec,
    Settings={GridMaxCount=0, GridMinCount=16, JaggedSeams=False, MaxEdgeLength=0, MinEdgeLength=0.0001, MinTolerance=0, Refine=True, RefineAngle=0, RelativeTolerance=0.65, SimplePlanes=True, Tolerance=0})
move = Move(Geometry=python.d, Motion=Z)  # -> Geometry, Transform
move_2 = Move(Geometry=python.b, Motion=Z)  # -> Geometry, Transform
move_3 = Move(Geometry=python.c, Motion=Z)  # -> Geometry, Transform
move_4 = Move(Geometry=python.a, Motion=Z)  # -> Geometry, Transform

# ---- group: RH_OUT:ComponentGeo
cylinder = Geometry(mesh)

# ----
pflip = FlipPlane(Plane=move_3.Geometry, ReverseX=False, ReverseY=False, SwapAxes=True)
pflip_2 = FlipPlane(Plane=move_2.Geometry, ReverseX=False, ReverseY=False, SwapAxes=True)
pflip_3 = FlipPlane(Plane=move_4.Geometry, ReverseX=False, ReverseY=True, SwapAxes=False)
pflip_4 = FlipPlane(Plane=move.Geometry, ReverseX=False, ReverseY=False, SwapAxes=True)

# ---- group: RH_OUT:ComponentInterface_Column_2
pln = Plane(pflip_2)

# ---- group: RH_OUT:ComponentInterface_TopColumn_2
pln_2 = Plane(python.b)

# ---- group: RH_OUT:ComponentInterface_TopColumn_3
pln_3 = Plane(python.c)

# ---- group: RH_OUT:ComponentInterface_Column_1
pln_4 = Plane(pflip_3)

# ---- group: RH_OUT:ComponentInterface_Column_4
pln_5 = Plane(pflip_4)

# ---- group: RH_OUT:ComponentInterface_TopColumn_1
pln_6 = Plane(python.a)

# ---- group: RH_OUT:ComponentInterface_TopColumn_4
pln_7 = Plane(python.d)

# ---- group: RH_OUT:ComponentInterface_Column_3
pln_8 = Plane(pflip)
