# Grasshopper definition wasp sample file.gh (Grasshopper 1.0.7)

pt = Point(Point(2.5, 2.5, 2))
pt_2 = Point(Point(6, 22, 0))
brep = Brep(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)
brep_2 = Brep(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)
pl = ConstructPlane(Origin=pt, XAxis="{1, 0, 0}", YAxis=Vector(0, 1, 0))
mesh = MeshBrep(
    Brep=brep,
    Settings={GridMaxCount=0, GridMinCount=16, JaggedSeams=False, MaxEdgeLength=0, MinEdgeLength=0.0001, MinTolerance=0, Refine=True, RefineAngle=0, RelativeTolerance=0.65, SimplePlanes=True, Tolerance=0})
brep_3 = Brep(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)
pl_2 = ConstructPlane(Origin=pt_2, XAxis="{0, 0, -1}", YAxis="{1, 0, 0}")
connpln = Wasp_ConnectionFromPlane(PLN=pl_2)  # -> CONN, PLN_OUT; inputs PLN: list of Plane, T: list; plug-in component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
connpln_2 = Wasp_ConnectionFromPlane(PLN=pl)  # -> CONN, PLN_OUT; inputs PLN: list of Plane, T: list; plug-in component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
part = Wasp_BasicPart(NAME="foundation", GEO=brep_2, CONN=flatten(connpln_2.CONN), COLL=mesh)  # -> PART; inputs GEO: Mesh, CONN: list, ATTR: list; plug-in component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
part_2 = Wasp_BasicPart(NAME="column", GEO=brep_3, CONN=flatten(connpln.CONN))  # -> PART; inputs GEO: Mesh, CONN: list, ATTR: list; plug-in component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
rule = Wasp_Rule(P1="foundation", C1="0", P2="column", C2="0")  # -> R; inputs C1: Int32, C2: Int32; plug-in component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
stochasticaggregation = Wasp_StochasticAggregation(PART=flatten([part, part_2]), PREV=part, N=Slider(2, range=0..10), RULES=rule, RESET=Toggle(True))  # -> AGGR, PART_OUT; inputs PART: list, PREV: list, N: Int32, RULES: list, SEED: Int32, MODE: Int32, GC: list, RESET: Boolean; plug-in component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
partgeo = Wasp_GetPartGeometry(PART=stochasticaggregation.PART_OUT)  # -> GEO; plug-in component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
